# Grasshopper definition write_objects_txt.gh (Grasshopper 1.0.7)
# plug-ins: RhinoCodePluginGH

geo = Geometry(<curve referenced from the Rhino model>)
debrep = DeconstructBrep(Brep=geo)  # -> Faces, Edges, Vertices
cp = ControlPoints(Curve=geo)  # -> Points, Weights, Knots
A = Point(<point referenced from the Rhino model>)
B = Point(<point referenced from the Rhino model>)
O = Point(<point referenced from the Rhino model>)
xprod = CrossProduct(Unitize=False)  # -> Vector, Length
geo_2 = Geometry(<curve referenced from the Rhino model>)
vec2pt = Vector2Pt(PointA=B, PointB=A, Unitize=False)  # -> Vector, Length
vec2pt_2 = Vector2Pt(PointA=B, PointB=O, Unitize=False)  # -> Vector, Length
divide = DivideCurve(Curve=geo_2, Count=Slider(33, range=1..100), Kinks=False)  # -> Points, Tangents, Parameters
ba = Vector(vec2pt.Vector)
bo = Vector(vec2pt_2.Vector)
path = FilePath("/Users/hristovassilev/Data/00_Projects/231023_GameTestground/03_SDL_3/assets/objects/polygon.txt")
script = Script(geom=cp.Points, fp=path, x=Button())  # -> out, a; inputs geom: tree
# ---------- script: Python ----------
from ghpythonlib import treehelpers as th

geom = th.tree_to_list(geom)
# print(geom)

with open(fp,'w') as f:
    for obj in geom:
        for pnt in obj:
            f.write(f"{pnt.X} {pnt.Y} <endpoint>\n")
            # print(f"{pnt.X},{pnt.Y}")
# ---------- end script ----------
item = ListItem(List=divide.Points, Index=0, Wrap=True)
xprod_2 = CrossProduct(VectorA=bo, VectorB=ba, Unitize=False)  # -> Vector, Length
merge = Merge(Data1=divide.Points, Data2=item)
xprod_3 = CrossProduct(VectorA=ba, VectorB=xprod_2.Vector, Unitize=False)  # -> unitize(Vector), Length
pt = Point(<point referenced from the Rhino model>)
vdis = VectorDisplay(Anchor=pt, Vector=xprod_3.Vector)
geo_3 = Geometry()
geo_4 = Geometry(<curve referenced from the Rhino model>)
debrep_2 = DeconstructBrep(Brep=geo_3)  # -> Faces, Edges, Vertices
mesh = MeshBrep(
    Brep=debrep_2.Faces,
    Settings={GridMaxCount=0, GridMinCount=16, JaggedSeams=False, MaxEdgeLength=0, MinEdgeLength=0.0001, MinTolerance=0, Refine=True, RefineAngle=0, RelativeTolerance=0.65, SimplePlanes=True, Tolerance=0})
medges = MeshEdges(Mesh=mesh)  # -> NakedEdges, InteriorEdges, NonManifoldEdges
debrep_3 = DeconstructBrep(Brep=mesh)  # -> Faces, Edges, Vertices
demesh = DeconstructMesh(Mesh=mesh)  # -> Vertices, Faces, Colours, Normals
